# Grasshopper definition Gadfly.gh (Grasshopper 0.9.75)
# plug-ins: Python Interpreter

path = FilePath("C:\Users\jvf\Desktop\SG Sandbox\Smart Geometry Ideas\Data\Hong Kong\GovHK\RoadsTraffic\tsm_link_and_node_info_v2.csv")
file = ReadFile(File=path, PerLineParse=True)
split = SplitList(List=file, Index=1)  # -> ListA, ListB
split_2 = StringSplit(String=split.ListB, Separators=",")
split_3 = StringSplit(String=split.ListA, Separators=",")
fields = Panel(split_3)
item = ListItem(List=split_2, Index=4, Wrap=False)
item_2 = ListItem(List=split_2, Index=1, Wrap=False)
item_3 = ListItem(List=split_2, Index=3, Wrap=False)
item_4 = ListItem(List=split_2, Index=2, Wrap=False)
item_5 = ListItem(List=split_2, Index=8, Wrap=False)
item_6 = ListItem(List=split_2, Index=7, Wrap=False)
pt = PointXYZ(XComponent=item_4, YComponent=item_3, ZComponent=0, System=PlaneXY(0, 0, 0))
py_item_index = PythonScript(D=item, S=flatten(item_2))  # -> out, i; inputs S: list
# ---------- py_item_index: Python ----------
import scriptcontext

idx = 0
for item in S:
    if item == D:
        i = idx
    else:
        idx += 1
# ---------- end py_item_index ----------
lng = ListLength(List=flatten(py_item_index.i))  # -> expr("x-1", Length)
item_7 = ListItem(List=flatten(pt), Index=py_item_index.i, Wrap=False)
random = Random(Range=lng, Number=1, Seed=py_item_index.i)
ln = Line(StartPoint=pt, EndPoint=item_7)
import_geojson = ImportGeoJSON()  # -> out, Geometry, Attributes, Values, LayerNames; inputs Import: Boolean, SiteNumber: Int32
# ---------- import_geojson: Python ----------
"""
Allows for the translation of GeoJSON data to Rhino objects

GeoJSON _does_ support 3d, so this can take 3d coordinates for 3d GeoJSONs

The GeoJSON Format Specification can be found here:
    http://geojson.org/geojson-spec.html

The RhinoCommon SDK (where all the Rhino.Geometry objects are documented) is
here:
    http://www.rhino3d.com/5/rhinocommon/

I have decided to extend the GeoJSON specification by adding support for one
more type of geometry that would be really useful in Rhino (and elsewhere),
the Mesh. Here is an example of a json Mesh:

    {"type": "Feature",
     "geometry": {
                  "type": "Mesh",
                  "coordinates": [
                                  [3.43, 54.234, 2343.23],
                                  [...],
                                  [...],
                                  ...,
                                  ]
                  "faces": [
                            [0,3,2],
                            [5,32,1],
                            ...,
                            ]
                  }
      "properties": {"prop0": "value0"}
      }


Example of Use:
    >>> import GeoJson2Rhino as geoj
    >>> myGeoJson = '''
{ "type": "FeatureCollection",
  "features": [
    { "type": "Feature",
      "geometry": {"type": "Point", "coordinates": [102.0, 0.5]},
      "properties": {"prop0": "value0"}
      },
    { "type": "Feature",
      "geometry": {
        "type": "LineString",
        "coordinates": [
          [102.0, 0.0], [103.0, 1.0], [104.0, 0.0], [105.0, 1.0]
          ]
        },
      "properties": {
        "prop0": "value0",
        "prop1": 0.0
        }
      },
    { "type": "Feature",
       "geometry": {
         "type": "Polygon",
         "coordinates": [
           [ [100.0, 0.0], [101.0, 0.0], [101.0, 1.0],
             [100.0, 1.0], [100.0, 0.0] ]
           ]
       },
       "properties": {
         "prop0": "value0",
         "prop1": {"this": "that"}
         }
       }
     ]
   }'''
   >>> guidList = geoj.load(myGeoJson) #stores guids of new rhino objects

"""

# Import standard library modules
import json
# Import Rhino modules
import Rhino
from Rhino.Geometry import *
from scriptcontext import doc

# import .NET libraries
import System
from System import Object
import rhinoscriptsyntax as rs
import sys
import os
import rhinoscriptsyntax as rs

# import GH dependencies
from clr import AddReference as addr
addr("Grasshopper")
from Grasshopper import DataTree
from Grasshopper.Kernel.Data import GH_Path

def addRhinoLayer(layerName, layerColor=System.Drawing.Color.Black):
    """Creates a Layer in Rhino using a name and optional color. Returns the
    index of the layer requested. If the layer
    already exists, the color is updated and no new layer is created."""
    docLyrs = doc.Layers
    layerIndex = docLyrs.Find(layerName, True)
    if layerIndex == -1:
        layerIndex = docLyrs.Add(layerName,layerColor)
    else: # it exists
        layer = docLyrs[layerIndex] # so get it
        if layer.Color != layerColor: # if it has a different color
            layer.Color = layerColor # reset the color
    return layerIndex

def PointToRhinoPoint(coordinates):
    if len(coordinates) > 2:
        z = coordinates[2]
    else:
        z = 0.0
    x, y = coordinates[0], coordinates[1]
    return Point3d(x, y, z)

def MultiPointToRhinoPoint(coordinates):
    rhPointList = []
    for point in coordinates:
        rhPointList.append(PointToRhinoPoint(point))
    return rhPointList

def MeshToRhinoMesh(coordinates, faces):
    rhMesh = Mesh()
    for point in coordinates:
        rhPoint = PointToRhinoPoint(point)
        rhMesh.Vertices.Add(rhPoint)
    for face in faces:
        i, j, k = tuple(face)
        mFace = MeshFace(i, j, k)
        rhMesh.Faces.AddFace(mFace)
    rhMesh.Normals.ComputeNormals()
    rhMesh.Compact()
    return rhMesh

def LineStringToRhinoCurve(coordinates):
    rhPoints = MultiPointToRhinoPoint(coordinates)
    return Curve.CreateControlPointCurve(rhPoints, 1)

def MultiLineStringToRhinoCurve(coordinates):
    rhCurveList = []
    for lineString in coordinates:
        rhCurveList.append(LineStringToRhinoCurve(lineString))
    return rhCurveList

def PolygonToRhinoCurve(coordinates):
    # each ring is a separate list of coordinates
    ringList = []
    for ring in coordinates:
        ringList.append(LineStringToRhinoCurve(ring))
    return ringList

def MultiPolygonToRhinoCurve(coordinates):
    polygonList = []
    for polygon in coordinates:
        polygonList.append(PolygonToRhinoCurve(polygon))
    return polygonList

def GeometryCollectionToParser(geometries):
    pass # I need to figure this one out still

def addPoint(rhPoint, objAtt):
    return doc.Objects.AddPoint(rhPoint, objAtt)

def addPoints(rhPoints, objAtt):
    guidList = []
    for rhPoint in rhPoints:
        guidList.append(doc.Objects.AddPoint(rhPoint, objAtt))
    return guidList

def addCurve(rhCurve, objAtt):
    return doc.Objects.AddCurve(rhCurve, objAtt)

def addCurves(rhCurves, objAtt):
    guidList = []
    for curve in rhCurves:
        guidList.append(addCurve(curve, objAtt))
    return guidList

def addPolygon(ringList, objAtt):
    # for now this just makes curves
    # but maybe it should make TrimmedSrfs
    # or should group the rings
    return addCurves(ringList, objAtt)

def addPolygons(polygonList, objAtt):
    guidList = []
    for polygon in polygonList:
        # !! Extending the guid list !!!
        guidList.extend(addPolygon(polygon, objAtt))
    return guidList

def addMesh(rhMesh, objAtt):
    return doc.Objects.AddMesh(rhMesh, objAtt)

geoJsonGeometryMap = {
        'Point':(PointToRhinoPoint, addPoint),
        'MultiPoint':(MultiPointToRhinoPoint, addPoints),
        'LineString':(LineStringToRhinoCurve, addCurve),
        'MultiLineString':(MultiLineStringToRhinoCurve, addCurves),
        'Polygon':(PolygonToRhinoCurve, addPolygon),
        'MultiPolygon':(MultiPolygonToRhinoCurve, addPolygons),
        'Mesh':(MeshToRhinoMesh, addMesh),
        'GeometryCollection':(GeometryCollectionToParser),
        }

def setUserKeys(properties, objAttributes):
    for key in properties:
        objAttributes.SetUserString(key, str(properties[key]))
    return objAttributes

def jsonToRhinoCommon(jsonFeature):
        # deal with the geometry
        geom = jsonFeature['geometry']
        geomType = geom['type'] # this will return a mappable string
        coordinates = geom['coordinates']
        # if this is a mesh, pass the faces
        if geomType == 'Mesh':
            faces = geom['faces']
            rhFeature = geoJsonGeometryMap[geomType][0](coordinates, faces)
        # translate the coordinates to Rhino.Geometry objects
        else:
            rhFeature = geoJsonGeometryMap[geomType][0](coordinates)
        return rhFeature

def addJsonFeature(jsonFeature, objAttributes):
        # deal with the properties
        if jsonFeature['properties']:
            objAttributes = setUserKeys(jsonFeature['properties'], objAttributes)
        geomType = jsonFeature['geometry']['type']
        rhFeature = jsonToRhinoCommon(jsonFeature)
        # return the GUID(s) for the feature
        return geoJsonGeometryMap[geomType][1](rhFeature, objAttributes)

def processGeoJson(parsedGeoJson,
         destinationLayer=None,
         destinationLayerColor=System.Drawing.Color.Black):
    # get the features
    jsonFeatures = parsedGeoJson['features']
    guidResults = []
    # set up object attributes
    for jsonFeature in jsonFeatures: # for each feature
        att = Rhino.DocObjects.ObjectAttributes()
        # setup layer if requested
        if destinationLayer != None:
            destinationLayer = None
            #att.LayerIndex = addRhinoLayer(destinationLayer,
                                           #destinationLayerColor)
        guidResults.append(addJsonFeature(jsonFeature, att))
    # return all the guids
    return guidResults
def load(rawJsonData,
         prefix=None,
         destinationLayer=None,
         destinationLayerColor=System.Drawing.Color.Black):
    # if the data already appears to be a dict literal ...
    if type(rawJsonData) == dict:
        jsonData = rawJsonData
    else: # otherwise, just try to load it
        jsonData = json.loads(rawJsonData)
    # if this is just a GeoJSON ...
    if jsonData["type"] == "FeatureCollection":
        # process the GeoJSON, pass the layer and color in
        return processGeoJson(jsonData, destinationLayer,
                              destinationLayerColor)
    # or if this is a set of layers from PostSites ...
    elif jsonData["type"] == "LayerCollection":
        # make a list for all the guids
        allResults = []
        layersList = jsonData['layers']
        for layer in layersList: # for each layer
            name = prefix + layer['name'] # get the name, modified to add filename to 
            if 'color' in layer: # get the color if it exists
                color = layer['color']
            else:
                color = destinationLayerColor # or just make it black
            geoJson = layer['contents'] # get the GeoJSON for this layer
            # make it
            layerResults = processGeoJson( geoJson, name, color )
            allResults.append(layerResults)
        return allResults, layersList
    else:
        return "This doesn't look like correctly formatted GeoJSON data.\nI'm not sure what to do with it, sorry."

idsOut = []
layerNamesOut = []
def getAttsVals(id,path=None):
    objct = doc.Objects.Find(id)
    data = objct.Attributes.GetUserStrings()
    d = {}
    k = []
    v = []
    if path==None:
        for u in sorted(data):
            k.append(u)
            print k
            d[u] = data[u]
            v.append(d[u])
        U = d
        Atts = k
        Vals = v
        return Atts,Vals
    if path:
        for u in data:
            k.append(u)
            d[u] = data[u]
            v.append(d[u])
            Attributes.Add(u,path)
            Values.Add(d[u],path)
        return None,None
    
def importSitefolder (filepath):
    f = str(SiteNumber)
    prefix = str(f +"_")
    try:
        f = open (filepath+"/"+f,'r')
    except:
        f = open (filepath+"/"+f+'.txt','r')
    myGeoJson = f.readline()
    guidList,layersList = load(myGeoJson, prefix)
    idsOut.append(guidList)
    layerNamesOut.append(layersList)
    f.close()

if Import!= None and type(Import) == bool:
    if Import == True:
        try:
            importSitefolder(geoJSONFolderPath)
            if guidList != None:
                message = 'You succesfully imported a geoJSON file!' 
            else:
                message = 'There was some problem with your geoJSON file, we imported as many layers as possible!'
                
        except:
            pass
else:
    print 'To Import you need to input a boolean toggle'

Geometry = DataTree[Object]()
Attributes = DataTree[Object]()
Values = DataTree[Object]()
LayerNames = DataTree[Object]()

### NOTE: some problems with mutlipolygons being nested 'up' a level. This problem is rooted in 'loader'
### it needs to be debugged out
for i in range (len(layerNamesOut[0])):
    p = GH_Path(i)
    LayerNames.Add(layerNamesOut[0][i]['name'],p)
    
for A in idsOut:#for each file
    for i in range (len(A)):# for each layer
        try:
            p = GH_Path(i)#make a new data tree path
            if (len(A[i])>1):# if the datatree path has more than one item
                for j in range (len(A[i])):# iterate
                    try:
                        thisId = A[i][j][0]
                        pPrime = p.AppendElement(j)
                        Geometry.Add(thisId,p)# add each feature to the path
                        getAttsVals(thisId,pPrime)
                    except:
                        ### It must be a point (tuple), cannot subscript it, grab it directly
                        try:
                            thisId = A[i][j]
                            pPrime = p.AppendElement(j)
                            Geometry.Add(thisId,p)
                            getAttsVals(thisId,pPrime)
                        except:
                            continue
            else:#otherwise, the layer has only one item (it is either a 1 item layer or a multipolygon)
                #it is a single object layer
                try:
                    thisId = A[i][0]
                    pPrime = p.AppendElement(0)
                    Geometry.Add(thisId,p)
                    getAttsVals(thisId,pPrime)
                except: #multipolygon is nested one level
                    print "Multipolygon found, some list-cleanup may be needed"
                    thisId = A[i][0][0]
                    pPrime = p.AppendElement(0)
                    Geometry.Add(thisId,p)
                    getAttsVals(thisId,pPrime)
        except:
            print 'There were some problems importing a layer, please try again with a different set of layers'
            continue
# ---------- end import_geojson ----------
Y = UnitY(Factor=1)
int = Integer(random)
len = Length(Curve=ln)
angle = Angle(VectorA=ln, VectorB=Y)  # -> Angle, Reflex
deg = Degrees(Radians=angle.Angle)
clean = CleanTree(Data=deg, CleanInvalid=True, CleanEmpty=False)
region = Panel(item_6)
road_type = Panel(item_5)
start_node_eastings = Panel(item_4)
start_node_northings = Panel(item_3)

# ---- group: GH Generated Properties
road_length = Panel(len)
road_angle_from_north = Panel(clean)

# ---- group: GH Generated Relationships
end_node_index = Panel(py_item_index.i)
random_node_index = Panel(int)

# ----
panel = Panel("""Region
Road Type
Start Node Eastings
Start Node Northings
Road Length
Road Angle From North""")
toggle = BooleanToggle(True)  # disabled
panel_2 = Panel("""End Node Index
Random Node Index""")
post_to_neo4j = Button()  # disabled
merge = Merge(
    Data1=simplify(region),
    Data2=simplify(road_type),
    Data3=simplify(start_node_eastings),
    Data4=simplify(start_node_northings),
    Data5=simplify(road_length),
    Data6=simplify(road_angle_from_north))
merge_2 = Merge(Data1=simplify(end_node_index), Data2=simplify(random_node_index))
python = PythonScript(Post_to_Neo4j=post_to_neo4j)  # -> out; inputs Property_Keys: list, Property_Values: tree, Relationship_Keys: list, Relationship_Values: tree; disabled
# ---------- python: Python ----------
# import modified py2neo from ironpython site packages
import sys
p = 'C:\\Program Files\\Rhinoceros 5.0 (64-bit)\\Plug-ins\\IronPython\\Lib\\site-packages'
if p not in sys.path:
    sys.path.append(p)
from py2neo import neo4j, node, rel

properties = []
relationships = []
# properties is a flat list of node_properties hashes
# one hash per node
for branch in Property_Values.Branches:
    node_properties = {}
    for idx, val in enumerate(branch):
        node_properties[Property_Keys[idx]] = val
    properties.append(node_properties)

# relationships is a flat list of relationship tuples,
# each node can have n relationships
for node_idx, branch in enumerate(Relationship_Values.Branches):    
    for idx, val in enumerate(branch):
        if val:
            relationships.append((int(node_idx), Relationship_Keys[idx], int(val)))
            
graph_db = neo4j.GraphDatabaseService("http://localhost:7474/db/data/")

# FIXME: Would it be better to 'try/except' and create nodes/relationships
# one at a time (less likely to break, will accept more errors in the data)
# Investigate the performance costs of this approach
if Post_to_Neo4j:
    batch = neo4j.WriteBatch(graph_db)
    
    for node_properties in properties:
        n = batch.create(node(node_properties)) 
        
    for node_relationship in relationships:
        batch.create(rel(node_relationship))
        
    results = batch.submit()
# ---------- end python ----------
gadflyread = PythonScript(pull=toggle)  # -> out, a; inputs pull: Boolean; disabled
# ---------- gadflyread: Python ----------
import sys
p = 'C:\\Program Files\\Rhinoceros 5.0 (64-bit)\\Plug-ins\\IronPython\\Lib\\site-packages'
if p not in sys.path:
    sys.path.append(p)
from py2neo import neo4j, node, rel

graph_db = neo4j.GraphDatabaseService("http://localhost:7474/db/data/")

if pull:
    stringResults = []
    gen = graph_db.match()
    results = list(gen)
    for rel in results:
        a = rel.start_node["name"]
        b = rel.end_node["name"]
        relat = rel.type
        stringResults.append((a,relat,b))
    a = stringResults
# ---------- end gadflyread ----------
post_to_neo4j_2 = Button()
gadflyread_2 = PythonScript(pull=Toggle(False))  # -> out, property_keys, property_values, relationship_keys, relationship_values; inputs pull: Boolean; same code as gadflyread
python_2 = PythonScript(
    Post_to_Neo4j=post_to_neo4j_2,
    Property_Keys=panel,
    Property_Values=merge,
    Relationship_Keys=panel_2,
    Relationship_Values=merge_2)  # -> out; inputs Property_Keys: list, Property_Values: tree, Relationship_Keys: list, Relationship_Values: tree; same code as python
panel_3 = Panel(gadflyread_2.property_keys)
